# Dynamo graph check_all_sheet_attributes_present.dyn "Script to Check All Sheet Attributes Present" (Dynamo 2.0.0.4654)

# group: Guidelines
# note: NOTE: ALWAYS RUN GRAPH IN MANAUAL MODE
# note: INSTRUCTIONS
# Always Choose Category as Sheets

# group: Choose Sheets
choose_categories_as_sheets = Categories(index=447)  # graph input

all_elements_of_category = ElementsOfCategory(Category=choose_categories_as_sheets)
parameters = Element.Parameters(element=all_elements_of_category)

# group: All parameter output
check_sheet_all_attributes = Watch(parameters)  # graph output

# group: Dynamo Details
code_block = CodeBlock { 1; }
code_block_2 = CodeBlock { "Check all the Sheet Paramters and its Attributes"; }
code_block_3 = CodeBlock { "Scrip to Check all Sheet Attributes Present"; }
code_block_4 = CodeBlock { "GET_ALL_SHEET_PARAMETERS_AND_ATTRIBUTES"; }
code_block_5 = CodeBlock { "0.0.1"; }
postMetricsToHums = PostMetricsToHums(value=code_block, description=code_block_2, scriptName=code_block_3, applicationAction=code_block_4, scriptVersion=code_block_5)
